# Grasshopper definition 09_walking_hexapod.ghx (Grasshopper 1.0.8)
# plug-ins: Motus
# Walking hexapod: Motus Hex + outdoor Ground + arc → WalkHex gait → Preview + Scrub. Not Stewart.

# ---- group: Walking Hex path
# Note: Hex (size) → WalkHex Hx; Ground → Tn; Planes arc → gait Tr → Preview scrub. Green rings = planted feet. Customize size on Hex; omit Hx = compact defaults.
Z = UnitZ(Factor=1)
goalpt = ConstructPoint(X=0.04, Y=2.2e-17, Z=0)
goalpt_2 = ConstructPoint(X=0.05370168415, Y=0.06888301783, Z=0)
goalpt_3 = ConstructPoint(X=0.09272077939, Y=0.1272792206, Z=0)
goalpt_4 = ConstructPoint(X=0.1511169822, Y=0.1662983159, Z=0)
goalpt_5 = ConstructPoint(X=0.22, Y=0.18, Z=0)
goalpt_6 = ConstructPoint(X=0.2888830178, Y=0.1662983159, Z=0)
goalpt_7 = ConstructPoint(X=0.3472792206, Y=0.1272792206, Z=0)
goalpt_8 = ConstructPoint(X=0.3862983159, Y=0.06888301783, Z=0)
goalpt_9 = ConstructPoint(X=0.4, Y=0, Z=0)
pl = PlaneNormal(Origin=goalpt, ZAxis=Z)
pl_2 = PlaneNormal(Origin=goalpt_2, ZAxis=Z)
pl_3 = PlaneNormal(Origin=goalpt_3, ZAxis=Z)
pl_4 = PlaneNormal(Origin=goalpt_4, ZAxis=Z)
pl_5 = PlaneNormal(Origin=goalpt_5, ZAxis=Z)
pl_6 = PlaneNormal(Origin=goalpt_6, ZAxis=Z)
pl_7 = PlaneNormal(Origin=goalpt_7, ZAxis=Z)
pl_8 = PlaneNormal(Origin=goalpt_8, ZAxis=Z)
pl_9 = PlaneNormal(Origin=goalpt_9, ZAxis=Z)
# 09 · Walking hexapod
goalpt_10 = ConstructPoint(X=0.22, Y=0, Z=0)
ground = MotusTerrainPatch(Origin=goalpt_10, SizeX=1, SizeY=0.8, Amp=0.1)
merge = Merge(Data1=pl, Data2=pl_2, Data3=pl_3, Data4=pl_4, Data5=pl_5, Data6=pl_6, Data7=pl_7, Data8=pl_8, Data9=pl_9)
hex = MotusHex(
    BodyR=0.06,
    Coxa=0.035,
    Femur=0.08,
    Tibia=0.1,
    BodyZ=0.07,
    HipStance=0.1309,
    FemurStance=0.5236,
    TibiaStance=-0.5236,
    ShowCollisionPreview=False)  # -> Hex, Robot, State, Meshes
walkhex = MotusWalkHex(Hex=hex.Hex, Planes=merge, Speed=0.06, Step=0.04, Lift=0.06, Terrain=ground, ShowCollisionPreview=False)  # -> Robot, State, Trajectory, PathCurve, PathPlanes, Meshes, Support

# ---- group: Gait Preview
scrub = Slider(0.655, range=0..1)
preview = MotusPreview(
    Trajectory=walkhex.Trajectory,
    ShowStart=False,
    Position=scrub,
    ColorMode=0,
    ShowCustomColors=False,
    ShowDebugOutputs=False)  # -> Meshes, Links, TCPPath, State, Time
