# Grasshopper definition 10_pick_place.ghx (Grasshopper 1.0.8)
# plug-ins: Motus
# UR10e pick-and-place: 3× Motus Program (approach / carry+Attach / retract) + table in ColScene. Attach hides workpiece only. Auto Plan on.

# ---- group: Robot + home TCP
# 10  Pick & place
ur10e = MotusUR10eRobotiq()
joints = MotusJointState(Joints=[0, -1.5708, 1.5708, 0, 1.5708, 0])
tcp = MotusTCPPose(Robot=ur10e, State=joints)

# ---- group: Place/retract offsets
deplane = DeconstructPlane(Plane=tcp)  # -> Origin, XAxis, YAxis, ZAxis
X = UnitX()
Y = UnitY()
Z = UnitZ()
amp = Amplitude(Vector=X, Amplitude=-0.05)
amp_2 = Amplitude(Vector=Y, Amplitude=0.05)
amp_3 = Amplitude(Vector=Z, Amplitude=0.1)
move = Move(Geometry=deplane.Origin, Translation=amp)
move_2 = Move(Geometry=move, Translation=amp_2)
pl = ConstructPlane(Origin=move_2, XAxis=deplane.XAxis, YAxis=deplane.YAxis)
move_3 = Move(Geometry=move_2, Translation=amp_3)
pl_2 = ConstructPlane(Origin=move_3, XAxis=deplane.XAxis, YAxis=deplane.YAxis)

# ---- group: Workpiece + table + Attach
goalpt = ConstructPoint(X=0.8264, Y=0.1991, Z=0.55)
Z_2 = UnitZ()
goalpt_2 = ConstructPoint(X=0.8514, Y=0.1741, Z=0.6136)
pl_3 = PlaneNormal(Origin=goalpt, ZAxis=Z_2)
colbox = MotusCollisionBox(Plane=pl_3, HalfX=0.22, HalfY=0.16, HalfZ=0.02, Name="table")
amp_4 = Amplitude(Vector=X, Amplitude=0.06)
pl_4 = PlaneNormal(Origin=goalpt_2, ZAxis=Z_2)
colbox_2 = MotusCollisionBox(Plane=pl_4, HalfX=0.03, HalfY=0.03, HalfZ=0.03, Name="workpiece")
deplane_2 = DeconstructPlane(Plane=pl_4)  # -> Origin, XAxis, YAxis, ZAxis
move_4 = Move(Geometry=deplane_2.Origin, Translation=amp_4)
merge = Merge(Data1=colbox_2, Data2=colbox)
pl_5 = ConstructPlane(Origin=move_4, XAxis=deplane.XAxis, YAxis=deplane.YAxis)
colscene = MotusCollisionScene(Objects=merge)  # -> Scene, Groups, EndEffectors
# Note: Approach → carry (Attach) → retract. Table stays in ColScene; Attach hides workpiece only. SET jaws ≠ Attach payload.
attach = MotusAttachBody(Object=colbox_2, Name="workpiece", GraspTcp=pl_5, SourceName="workpiece")

# ---- group: Approach Program
toolstate = MotusToolState(Tool=ur10e, Width=0.06, Speed=0.5, Force=0.5, ToolStatePreset="Custom", CanvasPivotX=568, CanvasPivotY=438)
move_5 = MotusMove(Type="LIN", Goal=pl_5, Blend=0, Step=0.005, MotionType="LIN", ToolMode="Hold", CanvasPivotX=728, CanvasPivotY=364)
move_6 = MotusMove(Type="SET", ToolState=toolstate, Duration=0, MotionType="SET", ToolMode="Hold", CanvasPivotX=737, CanvasPivotY=442)
merge_2 = Merge(Data1=move_5, Data2=move_6)
program = MotusProgram(Robot=ur10e, Segments=merge_2, Collision=colscene.Scene, AutoPlan=True)  # -> Trajectory, Status, Warnings

# ---- group: Carry Program
toolstate_2 = MotusToolState(Tool=ur10e, Width=0.085, Speed=0.5, Force=0.5, ToolStatePreset="Open", CanvasPivotX=568, CanvasPivotY=392)
move_7 = MotusMove(Type="SET", ToolState=toolstate, Duration=0, MotionType="SET", ToolMode="Hold", CanvasPivotX=737, CanvasPivotY=487)
move_8 = MotusMove(Type="LIN", Goal=pl, Blend=0, Step=0.005, MotionType="LIN", ToolMode="Hold", CanvasPivotX=737, CanvasPivotY=562)
move_9 = MotusMove(Type="SET", ToolState=toolstate_2, Duration=0, MotionType="SET", ToolMode="Hold", CanvasPivotX=737, CanvasPivotY=597)
merge_3 = Merge(Data1=move_7, Data2=move_8, Data3=move_9)
program_2 = MotusProgram(Robot=ur10e, Segments=merge_3, Collision=colscene.Scene, Attach=attach, Prior=program.Trajectory, AutoPlan=True)  # -> Trajectory, Status, Warnings

# ---- group: Retract Program
move_10 = MotusMove(Type="LIN", Goal=pl_2, Blend=0, Step=0.005, MotionType="LIN", ToolMode="Hold", CanvasPivotX=737, CanvasPivotY=742)
program_3 = MotusProgram(Robot=ur10e, Segments=move_10, Collision=colscene.Scene, Prior=program_2.Trajectory, AutoPlan=True)  # -> Trajectory, Status, Warnings

# ---- group: Preview
merge_4 = Merge(Data1=program.Trajectory, Data2=program_2.Trajectory, Data3=program_3.Trajectory)
scrub = Slider(0, range=0..1)
preview = MotusPreview(
    Trajectory=merge_4,
    ShowStart=True,
    Position=scrub,
    Scene=colscene.Scene,
    ColorMode=0,
    ShowCustomColors=False,
    ShowDebugOutputs=False)  # -> Meshes, Links, TCPPath, State, Time
